# Grasshopper definition Compute-VWT-DEMO.gh (Grasshopper 1.0.7)
# plug-ins: Compute

# ----
# LOGIN TO COMPUTE
panel = Panel("https://compute.procedural.build")
password = Text()
login = ComputeLogin(Username="username", Password=password, ComputeURL=panel)

# ----
# GEOMETRY
mesh = Mesh([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])

# ----
# GET OR CREATE
# PROJECT AND TASK
number_slider = Slider(1, range=0..10)
project_and_task = GetOrCreateProjectAndTask(Auth=login, ProjectName="Grasshopper Project", ProjectNumber=number_slider, TaskName="Grasshopper Task", Create=Button())

# ----
# CONFIGURE MESHING
number_slider_2 = Slider(2, range=0..10)
setnames = SetNames(Objs=mesh)
cfdmeshlevel = CfdMeshLevel(Objs=setnames, MinLevel=number_slider_2, MaxLevel=0)
toggle = BooleanToggle(True)
cfddomain = CFDDomain(
    Objs=cfdmeshlevel,
    CellSize=Slider(2, range=0..2),
    Z0=toggle,
    CenterXY=toggle,
    Square=toggle,
    XyScale=Slider(1.5, range=0..10),
    XyOffset=Slider(0, range=0..100),
    ZScale=Slider(2, range=0..10))  # -> Out, Bb, Objs
mesh_2 = ComputeMesh(Input=project_and_task, Domain=cfddomain.Out)

# ---- group: PREVIEW
wires = BrepWireframe(Brep=cfddomain.Bb, Density=-1)
preview = CustomPreview(Geometry=cfddomain.Objs, Material=ColourSwatch(SwatchColor=RGB(153, 153, 153)))
preview_2 = CustomPreview(Geometry=wires, Material=ColourSwatch(SwatchColor=RGB(0, 0, 0)))

# ----
# SET BOUNDARY CONDITIONS
panel_2 = Panel("""MaxZ
MinZ
MinX
MaxX""")
cfdbc = CfdBC(Names="MaxY", Preset="fixedVelocity", Overrides="{'U': '{ value uniform (0 -5 0); }'}")
cfdbc_2 = CfdBC(Names="MinY", Preset="fixedPressure")
cfdbc_3 = CfdBC(Names=panel_2, Preset="wall", Overrides="wallSlip")
merge = Merge(Data1=cfdbc, Data2=cfdbc_2, Data3=cfdbc_3)

# ----
# SETUP SOLVER
number_slider_3 = Slider(4, range=0..100)
list = ValueList({"potentialFoam", "simpleFoam"}, selected="simpleFoam")
panel_3 = Panel("""{
"init": 100, 
"run": 50
}""")
panel_4 = Panel("""2
1
1""")
cfd_solution = ComputeSolution(
    Input=mesh_2,
    CPUs=panel_4,
    Solver=list,
    CaseType="VirtualWindTunnel",
    BoundaryConditions=merge,
    Iterations=panel_3,
    NumberOfAngles=number_slider_3)

# ----
# RUN ON COMPUTE
button = Button()
compute = Compute(Input=cfd_solution, Mesh=cfddomain.Objs, Compute=button)

# ----
# Open Compute in Browser
button_2 = Button()
launch_browser = PythonScript(open=button_2)  # -> out
# ---------- launch_browser: Python ----------
import webbrowser

if url and taskId:
    url = url + "/task/" + taskId
    print url
else:
    print "Please provide server url and taskId"
    print "GOT url:", url, "TaskId:", taskId
if open:
    webbrowser.open(url, new=2)
# ---------- end launch_browser ----------
panel_5 = Panel(launch_browser)
