# Grasshopper definition ComputeVWT-DEMO_v20200812.gh (Grasshopper 1.0.7)
# plug-ins: Compute

# ----
# LOGIN TO COMPUTE
panel = Panel("https://compute.procedural.build")
password = Text()
# 0)
panel_2 = Panel("")
login = ComputeLogin(Username=panel_2, Password=password, ComputeURL=panel)

# ----
# GEOMETRY
mesh = Mesh([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])

# ----
# GET OR CREATE
# PROJECT AND TASK
number_slider = Slider(1, range=0..10)
# 1)
project_and_task = GetOrCreateProjectAndTask(
    Auth=login,
    ProjectName="Grasshopper Project",
    ProjectNumber=number_slider,
    TaskName="Grasshopper Task 9",
    Create=Button())

# ----
# CONFIGURE MESHING
number_slider_2 = Slider(2, range=0..10)
setnames = SetNames(Objs=mesh)
cfdmeshlevel = CfdMeshLevel(Objs=setnames, MinLevel=number_slider_2, MaxLevel=0)
toggle = BooleanToggle(True)
cfddomain = CFDDomain(
    Objs=cfdmeshlevel,
    CellSize=Slider(2, range=0..2),
    Z0=toggle,
    CenterXY=toggle,
    Square=toggle,
    XyScale=Slider(1.5, range=0..10),
    XyOffset=Slider(0, range=0..100),
    ZScale=Slider(2, range=0..10))  # -> Out, Bb, Objs
mesh_2 = ComputeMesh(Input=project_and_task, Domain=cfddomain.Out)

# ----
# SET BOUNDARY CONDITIONS
panel_3 = Panel("""MaxZ
MinZ
MinX
MaxX""")
cfdbc = CfdBC(Names="MaxY", Preset="fixedVelocity", Overrides="{'U': '{ value uniform (0 -5 0); }'}")
cfdbc_2 = CfdBC(Names="MinY", Preset="fixedPressure")
cfdbc_3 = CfdBC(Names=panel_3, Preset="wall", Overrides="wallSlip")
merge = Merge(Data1=cfdbc, Data2=cfdbc_2, Data3=cfdbc_3)

# ----
# SETUP SOLVER
number_slider_3 = Slider(4, range=0..100)
list = ValueList({"potentialFoam", "simpleFoam"}, selected="simpleFoam")
panel_4 = Panel("""{
"init": 100, 
"run": 50
}""")
# 2)
panel_5 = Panel("""2
2
1""")
cfd_solution = ComputeSolution(
    Input=mesh_2,
    CPUs=panel_5,
    Solver=list,
    CaseType="VirtualWindTunnel",
    BoundaryConditions=merge,
    Iterations=panel_4,
    NumberOfAngles=number_slider_3)

# ----
# CREATE A CUT PLANE
analysis_surface = AnalysisSurface(B=cfddomain.Bb, C=mesh)
python = GhPythonScript(testGeometry=analysis_surface, gridSize=Slider(1.9, range=0..3), distBaseSrf=Slider(1.5, range=0..3))  # -> readMe, testPoints, ptsVectors, facesArea, mesh; inputs testGeometry: GeometryBase
# ---------- python: Python ----------
### THIS COMPONENT IS COPIED FROM LADYBUG TOOLS. 
### IT IS COPIED TO MAKE DISTRIBUTION OF THIS GRASSHOPPER SCRIPT EASIER, BY HAVING LESS DEPENDENCIES.
### PLEASE REPLACE WITH THE ORIGINAL COMPONENT IF YOU HAVE LADYBUG INSTALLED

"""
Use this component to genrate a mesh with corresponding test points.  The resulting mesh will be in a format that the Recolor Mesh component will accept.
-
Provided by Honeybee 0.0.59
    Args:
        _testSurface: Test surface as a Brep.
        _gridSize: Size of the test grid.
        _distBaseSrf: Distance from base surface.
        moveTestMesh_: Set to 'False' if you want test mesh not to move. Default is 'True'.
    Returns:
        readMe!: ...
        testPoints: Test points
        ptsVectors: Vectors
        faceArea: Area of each mesh face
        mesh: Analysis mesh
"""

import Rhino as rc
import Grasshopper.Kernel as gh
from itertools import chain
import System.Threading.Tasks as tasks

def createMesh(brep, gridSize):
    ## mesh breps
    def makeMeshFromSrf(i, inputBrep):
        try:
            mesh[i] = rc.Geometry.Mesh.CreateFromBrep(inputBrep, meshParam)[0]
            inputBrep.Dispose()
        except:
            print 'Error in converting Brep to Mesh...'
            pass

    # prepare bulk list for each surface
    mesh = [None] * len(brep)

    # set-up mesh parameters for each surface based on surface size
    meshParam = rc.Geometry.MeshingParameters.Default
    meshParam.MaximumEdgeLength = gridSize
    meshParam.MinimumEdgeLength = gridSize
    meshParam.GridAspectRatio = 1

    for i in range(len(mesh)): makeMeshFromSrf(i, brep[i])
    
    return mesh

def flattenList(l):return list(chain.from_iterable(l))

def getTestPts(inputMesh, movingDis, moveTestMesh= False, parallel = True):
        
        # preparing bulk lists
        testPoint = [[]] * len(inputMesh)
        srfNormals = [[]] * len(inputMesh)
        meshSrfCen = [[]] * len(inputMesh)
        meshSrfArea = [[]] * len(inputMesh)
        
        srfCount = 0
        for srf in inputMesh:
            testPoint[srfCount] = range(srf.Faces.Count)
            srfNormals[srfCount] = range(srf.Faces.Count)
            meshSrfCen[srfCount] = range(srf.Faces.Count)
            meshSrfArea[srfCount] = range(srf.Faces.Count)
            srfCount += 1

        try:
            def srfPtCalculator(i):
                # calculate face normals
                inputMesh[i].FaceNormals.ComputeFaceNormals()
                inputMesh[i].FaceNormals.UnitizeFaceNormals()
                
                for face in range(inputMesh[i].Faces.Count):
                    srfNormals[i][face] = (inputMesh[i].FaceNormals)[face] # store face normals
                    meshSrfCen[i][face] = inputMesh[i].Faces.GetFaceCenter(face) # store face centers
                    # calculate test points
                    if srfNormals[i][face]:
                        movingVec = rc.Geometry.Vector3f.Multiply(movingDis,srfNormals[i][face])
                        testPoint[i][face] = rc.Geometry.Point3d.Add(rc.Geometry.Point3d(meshSrfCen[i][face]), movingVec)
                    # make mesh surface, calculate the area, dispose the mesh and mass area calculation
                    tempMesh = rc.Geometry.Mesh()
                    tempMesh.Vertices.Add(inputMesh[i].Vertices[inputMesh[i].Faces[face].A]) #0
                    tempMesh.Vertices.Add(inputMesh[i].Vertices[inputMesh[i].Faces[face].B]) #1
                    tempMesh.Vertices.Add(inputMesh[i].Vertices[inputMesh[i].Faces[face].C]) #2
                    tempMesh.Vertices.Add(inputMesh[i].Vertices[inputMesh[i].Faces[face].D]) #3
                    tempMesh.Faces.AddFace(0, 1, 3, 2)
                    massData = rc.Geometry.AreaMassProperties.Compute(tempMesh)
                    meshSrfArea[i][face] = massData.Area
                    massData.Dispose()
                    tempMesh.Dispose()
                    
                    
        except:
            print 'Error in Extracting Test Points'
            pass
        
        # calling the function
        if parallel:
            tasks.Parallel.ForEach(range(len(inputMesh)),srfPtCalculator)
        else:
            for i in range(len(inputMesh)):
                srfPtCalculator(i)
        
        if moveTestMesh:
            # find surfaces based on first normal in srfNormals - It is a simplification we can write a better function for this later
            for meshCount, mesh in enumerate(inputMesh):
                vector = srfNormals[meshCount][0]
                vector.Unitize()
                vector = rc.Geometry.Vector3d.Multiply(movingDis, vector)
                mesh.Translate(vector.X, vector.Y, vector.Z)
                
        return flattenList(testPoint), flattenList(srfNormals), flattenList(meshSrfArea), inputMesh


if _testGeometry!=None:
    inputMesh = []
    
    if type(_testGeometry) == rc.Geometry.Mesh and _distBaseSrf!=None:
        ghenv.Component.Params.Input[1].Name = '.'
        ghenv.Component.Params.Input[1].NickName = '.'
        inputMesh.append(_testGeometry)
        
    elif _gridSize!=None and _distBaseSrf!=None:
        initMesh = createMesh([_testGeometry], _gridSize)
        for m in initMesh: inputMesh.append(m)   

    if _distBaseSrf<0:
        msg = "Distance from base should be greater than 0. Flip the input surface instead of using a negative number."
        ghenv.Component.AddRuntimeMessage(gh.GH_RuntimeMessageLevel.Warning, msg)
    else:
        testPoints, ptsVectors, facesArea, mesh = getTestPts(inputMesh, _distBaseSrf, moveTestMesh_)
# ---------- end python ----------

# ----
# Display
# Get Started: If you haven't done already, sign up for a free user account at https://compute.procedural.build/ to get started!
# 
# 0) Add your username (email) and password.
# 
# 1) Update the project name, number and task name. To create the new project and task click the button.
# 
# 2) Update the solver configuration or leave the defaults.
# 
# 3) Click the button to upload and start simulating the case.
# 
# 4) Click the button to add the probe points. Make sure to create the C:/Procedural/ComputeVWTDemo folder to store the results in.
# 
# 5) Wait for the simulation to finish and visualise the results.
# 
# 6) Check the simulation progress in the browser.
# 
# If you are having any questions, issues or feedback, you are welcome to post them at https://discourse.procedural.build/
# We will be there to answer any queries!
swatch = ColourSwatch(SwatchColor=RGB(0, 0, 0))
medges = MeshEdges(Mesh=python.mesh)  # -> NakedEdges, InteriorEdges, NonManifoldEdges
wires = BrepWireframe(Brep=cfddomain.Bb, Density=-1)
preview = CustomPreview(Geometry=wires, Material=ColourSwatch(SwatchColor=RGB(0, 0, 0)))
preview_2 = CustomPreview(Geometry=cfddomain.Objs, Material=ColourSwatch(SwatchColor=RGB(153, 153, 153)))
preview_3 = CustomPreview(Geometry=[medges.NakedEdges, medges.InteriorEdges], Material=swatch)

# ----
# RUN ON COMPUTE
button = Button()
# 3)
compute = Compute(Input=cfd_solution, Mesh=cfddomain.Objs, Compute=button)

# ----
# Open Compute in Browser
button_2 = Button()
# 6)
launch_browser = PythonScript(url=panel, input=project_and_task, open=button_2)  # -> out
# ---------- launch_browser: Python ----------
import webbrowser
import json

taskId = ""
if input:
    input_ = json.loads(input)
    task = input_.get("task")
    if task:
        taskId = task.get("uid")



if url and taskId:
    url = url + "/task/" + taskId
    print url
else:
    print "Please provide server url and taskId"
    print "GOT url:", url, "TaskId:", taskId
if open:
    webbrowser.open(url, new=2)
# ---------- end launch_browser ----------
panel_6 = Panel(launch_browser)

# ----
# PROBE AND DOWNLOAD
button_3 = Button()
# 4)
panel_7 = Panel("""U
p""")
probe_points = ProbePoints(Input=compute, Points=python.testPoints, Fields=panel_7, Create=button_3)
# https://compute.procedural.build
button_4 = Button()
download = Download(
    Input=probe_points,
    DownloadPath="VWT/postProcessing/internalCloud",
    LocalPath="C:\Procedural\ComputeVWTDemo",
    Reload=button_4)

probe_results = ProbeResults(Folder=download)  # -> Info, U, P
panel_8 = Panel(probe_results.Info)
vlen = VectorLength(Vector=probe_results.U)

# ----
# Visualize Vectors
bang = ExplodeTree(Data=probe_results.U)  # -> Branch0, Branch1, Branch2, Branch3
bnd = Bounds(Numbers=flatten(vlen))
dedomain = DeconstructDomain(Domain=bnd)  # -> Start, End
gradient = Gradient(
    LowerLimit=dedomain.Start,
    UpperLimit=dedomain.End,
    Parameter=bang.Branch0,
    stops=[0: RGB(0, 128, 0), 0.5: RGB(255, 255, 0), 1: RGB(255, 0, 0)])
vdisex = VectorDisplayEx(Point=python.testPoints, Vector=bang.Branch0, Colour=gradient, Width=2)

# ----
# Visualize Values
# 5)
bang_2 = ExplodeTree(Data=vlen)  # -> Branch0, Branch1, Branch2, Branch3
recolormesh = RecolorMesh(
    Mesh=python.mesh,
    Result=bang_2.Branch0,
    ListOfColors=[ColourSwatch(SwatchColor=RGB(255, 255, 255)), ColourSwatch(SwatchColor=RGB(133, 60, 60)), ColourSwatch(SwatchColor=RGB(0, 0, 0))],
    LowerBoundary=dedomain.Start,
    UpperBoundary=dedomain.End)

# ==== cluster AnalysisSurface: This is just cluster of GH components to create and select a analysis surface
C = ClusterInput()
B = ClusterInput()
bbox = BoundingBox(Content=C, Plane=PlaneXY(0, 0, 0))  # -> Box, Box_2
debox = DeconstructBox(Box=B)  # -> Plane, X, Y, Z
planesrf = PlaneSurface(Plane=PlaneXY(0, 0, 0), XSize=debox.X, YSize=debox.Y)
bbx = BrepBrep(BrepA=planesrf, BrepB=bbox.Box)  # -> flatten(Curves), Points
srfsplit = SurfaceSplit(Surface=planesrf, Curves=bbx.Curves)
area = Area(Geometry=srfsplit)  # -> Area, Centroid
sort = SortList(Keys=area.Area)  # -> reverse(Keys), ValuesA
item = ListItem(List=sort.Keys, Index=0, Wrap=True)
equals = Equality(FirstNumber=area.Area, SecondNumber=item)  # -> Equality, Inequality
cull = CullPattern(List=srfsplit, CullPattern=equals.Equality)
L = ClusterOutput(cull)
